# Grasshopper definition simple_api_test.gh (Grasshopper 1.0.8)

number_input = GetNumber("10", AtLeast=1, AtMost=1, Maximum=1.797693135e+308, Minimum=-1.797693135e+308, TreeAccess=False)
number_input_2 = GetNumber("20", AtLeast=1, AtMost=1, Maximum=1.797693135e+308, Minimum=-1.797693135e+308, TreeAccess=False)
addition = Addition(A=number_input, B=number_input_2)
context_print = ContextPrint(Text=addition)
